# Grasshopper definition cedar_floor_planner.gh (Grasshopper 1.0.8)

length = Slider(6.6, range=0..100)
width = Slider(20.2, range=0..100)
rectangle = Rectangle(Plane=PlaneXY(0, 0, 0), XSize=length, YSize=width, Radius=0)  # -> Rectangle, Length
curve = Curve(rectangle.Rectangle)
python_3_script = Python3Script(boundary_crv=curve)  # -> boundary_output, rectangles, labels, gross_floor_area, net_floor_area, private_area, common_area, packing_efficiency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; inputs boundary_crv: Curve
# ---------- python_3_script: Python ----------
"""
Grasshopper integration for Cedar Floor Planner
Boundary-driven version with multi-variant packing
"""

import sys
import os
import Rhino.Geometry as rg
import System.Drawing as sd

# --------------------------------------------------
# 1️⃣ PROJECT PATH
# --------------------------------------------------

project_root = r"C:\Users\Vaibhav\OneDrive\Documents\Cedar\Technical challenge\cedar-floor-planner"

gh_path = os.path.join(project_root, "gh")

if gh_path not in sys.path:
    sys.path.append(gh_path)

# --------------------------------------------------
# 2️⃣ IMPORT BACKEND
# --------------------------------------------------

from models.boundary import Boundary
from services.csv_loader import load_rooms_from_csv
from services.packing_engine import pack_rooms
from models.layout import Layout
from services.exporter import export_layout


# --------------------------------------------------
# 3️⃣ CHECK INPUT
# --------------------------------------------------


if boundary_crv is None:

    rooms_geometry = "Draw and connect a rectangle boundary"
    room_label_points = None
    gross_floor_area = None
    net_floor_area = None
    private_area = None
    common_area = None
    packing_efficiency = None

else:

    bbox = boundary_crv.GetBoundingBox(True)

    width = bbox.Max.X - bbox.Min.X
    height = bbox.Max.Y - bbox.Min.Y

    boundary = Boundary(width, height)

    # --------------------------------------------------
    # 4️⃣ LOAD ROOM PROGRAM
    # --------------------------------------------------

    csv_path = os.path.join(project_root, "data", "room_program.csv")

    # --------------------------------------------------
    # 5️⃣ MULTI VARIANT PACKING
    # --------------------------------------------------

    variant_configs = [

        {"rotation": False, "sort_strategy": "area_desc", "aspect_ratio_multiplier": 1.0},
        {"rotation": True,  "sort_strategy": "area_desc", "aspect_ratio_multiplier": 1.0},
        {"rotation": False, "sort_strategy": "area_asc",  "aspect_ratio_multiplier": 1.0},
        {"rotation": True,  "sort_strategy": "area_asc",  "aspect_ratio_multiplier": 1.0},

    ]

    profiles = ["compact", "balanced", "generous"]

    variants = []

    for profile in profiles:

        for config in variant_configs:

            rooms = load_rooms_from_csv(csv_path, profile=profile)

            packed_rooms = pack_rooms(boundary, rooms, config=config)

            layout_variant = Layout(boundary, packed_rooms)

            variants.append({
                "profile": profile,
                "config": config,
                "layout": layout_variant,
                "efficiency": layout_variant.packing_efficiency()
            })


    best_variant = max(variants, key=lambda v: v["efficiency"])

    variant_efficiencies = [v["efficiency"] for v in variants]

    variant_summary = []

    for i, v in enumerate(variants):

        config = v["config"]
        profile = v["profile"]
        eff = v["efficiency"]

        line = f"Variant {i} | profile={profile} | rotation={config['rotation']} | sort={config['sort_strategy']} | efficiency={eff:.3f}"

        variant_summary.append(line)


    selected_variant = variants.index(best_variant)
    variant_summary[selected_variant] += "  ← SELECTED"

    layout = best_variant["layout"]

    layout.selected_profile = best_variant["profile"]
    layout.selected_rotation = best_variant["config"]["rotation"]
    layout.selected_sort = best_variant["config"]["sort_strategy"]
    layout.variants_tested = len(variants)

    # --------------------------------------------------
    # 6️⃣ EXPORT JSON
    # --------------------------------------------------

    export_path = os.path.join(project_root, "exports", "layout.json")
    export_layout(layout, export_path)

    # --------------------------------------------------
    # 7️⃣ CREATE RHINO GEOMETRY
    # --------------------------------------------------

    rectangles = []
    labels = []
    room_names = []
    room_colors = []

    boundary_height = height

    for room in layout.rooms:

        x = room.x
        y = room.y
        w = room.width
        h = room.height

        flipped_y = boundary_height - (y + h)

        p0 = rg.Point3d(x, flipped_y, 0)
        p1 = rg.Point3d(x + w, flipped_y, 0)
        p2 = rg.Point3d(x + w, flipped_y + h, 0)
        p3 = rg.Point3d(x, flipped_y + h, 0)

        poly = rg.Polyline([p0, p1, p2, p3, p0])
        rectangles.append(poly)

        center = rg.Point3d(x + w / 2, flipped_y + h / 2, 0)
        labels.append(center)

        room_names.append(room.name)

        if room.category == "common":
            room_colors.append(sd.Color.FromArgb(100,180,100))
        else:
            room_colors.append(sd.Color.FromArgb(100,150,220))

    # --------------------------------------------------
    # 8️⃣ METRICS
    # --------------------------------------------------

    gross_floor_area = layout.boundary.area()
    net_floor_area = layout.net_floor_area()
    private_area = layout.private_area()
    common_area = layout.common_area()
    packing_efficiency = layout.packing_efficiency()

    # --------------------------------------------------
    # OUTPUTS
    # --------------------------------------------------

    boundary_output = boundary_crv
    rooms_geometry = rectangles
    room_label_points = labels

    variant_efficiencies_output = variant_efficiencies
    variant_configs_output = variant_configs
    selected_variant_index = selected_variant

    room_names_output = room_names
    room_colors_output = room_colors

    variant_summary_output = variant_summary
# ---------- end python_3_script ----------

curve_2 = Curve(python_3_script.boundary_output)
panel = Panel(curve_2)

curve_3 = Curve(python_3_script.rectangles)
panel_2 = Panel(curve_3)

point = Point(python_3_script.labels)
panel_3 = Panel(point)

number = Number(python_3_script.gross_floor_area)
panel_4 = Panel(number)

number_2 = Number(python_3_script.net_floor_area)
panel_5 = Panel(number_2)

number_3 = Number(python_3_script.private_area)
panel_6 = Panel(number_3)

number_4 = Number(python_3_script.common_area)
panel_7 = Panel(number_4)

number_5 = Number(python_3_script.packing_efficiency)
panel_8 = Panel(number_5)

number_6 = Number(python_3_script.variant_efficiencies_output)
panel_9 = Panel(number_6)

data = Data(python_3_script.variant_configs_output)
panel_10 = Panel(data)

number_7 = Number(python_3_script.selected_variant_index)
panel_11 = Panel(number_7)

data_2 = Data(python_3_script.room_names_output)
panel_12 = Panel(data_2)

data_3 = Data(python_3_script.room_colors_output)
panel_13 = Panel(data_3)

data_4 = Data(python_3_script.variant_summary_output)
panel_14 = Panel(data_4)

curve_4 = Curve(curve_3)
custom_curve_preview = CustomCurvePreview(Curve=curve_4, Linetype={Path="(Continuous)", Segments=[]}, Colour=ColourSwatch(SwatchColor=RGB(0, 0, 0)))

surface = Surface(curve_3)
data_5 = Data(data_3)
custom_preview = CustomPreview(Geometry=surface, Material=data_5)

curve_5 = Curve(curve_2)
custom_curve_preview_2 = CustomCurvePreview(Curve=curve_5, Linetype={Path="(Continuous)", Segments=[]}, Colour=ColourSwatch(SwatchColor=RGB(0, 0, 0)))

point_2 = Point(point)
data_6 = Data(data_2)
text_tag_3d = TextTag3D(
    Location=point_2,
    Text=data_6,
    Size=Slider(0.25, range=0..1),
    Colour=ColourSwatch(SwatchColor=RGB(0, 0, 0)),
    Justification=5)
